vi "From double.gvi"   [LabVIEW NXG 3.1.0]
inputs:
  "Probability": f64, required
outputs:
  "Error Out": error
  "Friendly Probability out": "Friendly probability.gtype"
uses:
  NI::G Core::Error::Build Error Cluster.gvi
  Gregstoll::ProbabilityToFriendlyString::Friendly probability.gtype::From double core.gvi
  Gregstoll::ProbabilityToFriendlyString::Friendly probability.gtype::Create.gvi
diagram:
  In Range And Coerce[IncludeHighLimit=True](lower limit=0, upper limit=1, x=$Probability) -> (In Range?=w1)
  case (w1) {
    frame False, Default {
      Format Into String(formatString="Probability %d must be between 0 and 1!", $Probability) -> w4
      call "Build Error Cluster.gvi"(code=1, description=w4) -> (error out=w2)
      w3 = default
    }
    frame True {
      Is Greater(x=$Probability, y=0.99) -> w5
      case (w5) {
        frame False, Default {
          Is Less(x=$Probability, y=0.01) -> w6
          case (w6) {
            frame False, Default {
              call "From double core.gvi"(Probability=$Probability) -> (Friendly Probability out=w3)
            }
            frame True {
              Is Equal(x=$Probability, y=0) -> w7
              call "Create.gvi"(Numerator=0, Denominator=1) -> (FriendlyProbability out=w8)
              call "Create.gvi"(Numerator=1, Denominator=100, Friendly String="<1 in 100") -> (FriendlyProbability out=w9)
              Select(s=w7, t=w8, f=w9) -> w3
            }
          }
        }
        frame True {
          Is Equal(x=$Probability, y=1) -> w10
          call "Create.gvi"(Numerator=1, Denominator=1) -> (FriendlyProbability out=w11)
          call "Create.gvi"(Numerator=99, Denominator=100, Friendly String=">99 in 100") -> (FriendlyProbability out=w12)
          Select(s=w10, t=w11, f=w12) -> w3
        }
      }
      w2 = no error
    }
  }
  $"Error Out" <- w2
  $"Friendly Probability out" <- w3
