vi "Parse test case.gvi"   [LabVIEW NXG 4.0.0]
inputs:
  "Line number": u32, required
  "Line": string, required
outputs:
  "Is valid?": bool
  "Test case": "Test case.gtype"
  "Error Out": error
types:
  "Test case.gtype" = cluster{"Probability": f64, "Expected Friendly Probability": "Friendly probability.gtype", "Line number": u32}
uses:
  NI::G Core::Strings::Delimited String to 1D String Array.gvi
  Gregstoll::ProbabilityToFriendlyString::Friendly probability.gtype::Create.gvi
  NI::G Core::Error::Build Error Cluster.gvi
diagram:
  call "Trim and should filter line.gvi"(Line=$Line) -> (Line out=w1, should skip?=w2)
  case (w2) {
    frame False, Default {
      call "Delimited String to 1D String Array.gvi"(delimited string=w1, delimiter=",") -> (string array=w6)
      Array Size(array=w6) -> (size(s)=w7)
      case (w7) {
        frame 3 {
          Array Index(array=w6) -> (out0[_]=w8, out1[_]=w9, out2[_]=w10)
          Floating Point String To Number(string=w8) -> (number=w11)
          Decimal String To Number(string=w9) -> (number=w12)
          Decimal String To Number(string=w10) -> (number=w13)
          call "Create.gvi"(Numerator=w12, Denominator=w13) -> (FriendlyProbability out=w14)
          Property Node(instance in="Test case.gtype" {all zero or empty}, "Probability"=w11, "Expected Friendly Probability"=w14, "Line number"=$"Line number") -> (instance out=w4)
          w5 = no error
          w3 = TRUE
        }
        frame 4 {
          Array Index(array=w6) -> (out0[_]=w15, out1[_]=w16, out2[_]=w17, out3[_]=w18)
          Floating Point String To Number(string=w15) -> (number=w19)
          Decimal String To Number(string=w16) -> (number=w20)
          Decimal String To Number(string=w17) -> (number=w21)
          call "Create.gvi"(Numerator=w20, Denominator=w21, Friendly String=w18) -> (FriendlyProbability out=w22)
          Property Node(instance in="Test case.gtype" {all zero or empty}, "Probability"=w19, "Expected Friendly Probability"=w22, "Line number"=$"Line number") -> (instance out=w4)
          w5 = no error
          w3 = TRUE
        }
        frame Default {
          Format Into String(formatString="Line %d in testCases.txt is malformed: \"%s\"", $"Line number", w1) -> w23
          call "Build Error Cluster.gvi"(code=1, description=w23) -> (error out=w5)
          w4 = "Test case.gtype" {all zero or empty}
          w3 = FALSE
        }
      }
    }
    frame True {
      w3 = FALSE
      w4 = "Test case.gtype" {all zero or empty}
      w5 = no error
    }
  }
  $"Is valid?" <- w3
  $"Test case" <- w4
  $"Error Out" <- w5
