vi "Run tests.gvi"   [LabVIEW NXG 4.0.0]
outputs:
  "pass?": bool
  "Errors": string[]
panel indicators:
  "error out": error
uses:
  Gregstoll::ProbabilityToFriendlyStringTests::Read test cases friendly description.gvi
  Gregstoll::ProbabilityToFriendlyString::Friendly probability.gtype::From double.gvi
  Gregstoll::ProbabilityToFriendlyStringTests::Read test cases.gvi
  Gregstoll::ProbabilityToFriendlyString::Friendly probability.gtype::To string.gvi
diagram:
  call "Read test cases friendly description.gvi"() -> (test cases=w1)
  for {
    w2 = each element of w1
    Property Node(instance in=w2) -> ("Probability"=w5, "Expected friendly description"=w6, "Line number"=w7)
    call "From double.gvi"(Probability=w5) -> (Friendly Probability out=w8, Error Out=w9)
    Property Node(instance in=w8) -> ("Friendly Description"=w10)
    Is Equal[ComparisonMode=CompareAggregates](x=w10, y=w6) -> w11
    case (w11) {
      frame False, Default {
        w14 = "friendly probability expected %s actual %s for %f line number %d"
        Format Into String(formatString=w14, w6, w10, w5, w7) -> w12
        w13 = TRUE
      }
      frame True {
        w12 = ""
        w13 = FALSE
      }
    }
    append w9 to w3
    append w12 to w4 if w13
  }
  call "Read test cases.gvi"() -> (test cases=w15, error out=w16)
  for {
    w17 = each element of w15
    Property Node(instance in=w17) -> ("Probability"=w20, "Expected Friendly Probability"=w21, "Line number"=w22)
    call "From double.gvi"(Probability=w20) -> (Friendly Probability out=w23, Error Out=w24)
    Is Equal[ComparisonMode=CompareAggregates](x=w21, y=w23) -> w25
    case (w25) {
      frame True {
        w26 = FALSE
        w27 = ""
      }
      frame False {
        call "To string.gvi"(Friendly Probability=w23) -> (string=w28)
        call "To string.gvi"(Friendly Probability=w21) -> (string=w29)
        Format Into String(formatString="expected %s actual %s for %f line number %d", w29, w28, w20, w22) -> w27
        w26 = TRUE
      }
    }
    append w24 to w18
    append w27 to w19 if w26
  }
  Merge Errors(w16, w18, w3) -> (error out=w30)
  Build Array(w19, w4) -> w31
  Array Size(array=w31) -> (size(s)=w32)
  Is Greater Than 0(x=w32) -> w33
  Logical Or[output inverted](w30, w33) -> w34
  $"pass?" <- w34
  $"error out" <- w30
  $Errors <- w31
